# Grasshopper definition port(1).gh (Grasshopper 1.0.8)

py3 = Python3Script(seed=Slider(5, range=0..10))  # -> A, B, C
# ---------- py3: Python ----------
import json
import random

# GH input:
# seed : int   (Integer Slider, e.g. 0..10000)

MIN_V = 15
MAX_V = 250

if seed is None:
    seed = 0

seed = int(seed)

# deterministic RNG from seed
rng = random.Random(seed)

data = [
    {"name": "Living",  "parent": "Indoor",  "value": rng.randint(MIN_V, MAX_V)},
    {"name": "Kitchen", "parent": "Indoor",  "value": rng.randint(MIN_V, MAX_V)},
    {"name": "Bedroom", "parent": "Terrace", "value": rng.randint(MIN_V, MAX_V)},
    {"name": "Deck",    "parent": "Outdoor", "value": rng.randint(MIN_V, MAX_V)},
    {"name": "Garden",  "parent": "Outdoor", "value": rng.randint(MIN_V, MAX_V)},
    {"name": "Pool",    "parent": "Outdoor", "value": rng.randint(MIN_V, MAX_V)},
]

# GH outputs:
# A: data (list of dicts)
# B: json_text (string)
# C: values_only (list of numbers)
A = data
B = json.dumps(data, indent=2)
C = [d["value"] for d in data]
# ---------- end py3 ----------
py3_2 = Python3Script(data=py3.B, send=Toggle(True))  # -> A, B; inputs data: list, send: Boolean
# ---------- py3_2: Python ----------
import json
import hashlib
import urllib.request
import scriptcontext as sc

# GH input:
# data : list[dict]  (your treemap list: name,parent,value)
# send : bool

URL = "http://127.0.0.1:8765/update"

def stable_json(obj):
    return json.dumps(obj, ensure_ascii=False, sort_keys=True, separators=(",", ":"))

ok = False
msg = "send=False"

if send and data is not None:
    payload_text = stable_json(data)
    new_hash = hashlib.sha256(payload_text.encode("utf-8")).hexdigest()
    old_hash = sc.sticky.get("treemap_hash")

    if new_hash != old_hash:
        req = urllib.request.Request(
            URL,
            data=payload_text.encode("utf-8"),
            headers={"Content-Type": "application/json"},
            method="POST",
        )
        try:
            with urllib.request.urlopen(req, timeout=1.5) as r:
                _ = r.read()
            sc.sticky["treemap_hash"] = new_hash
            ok = True
            msg = "Posted update (changed)."
        except Exception as e:
            msg = "POST failed: {}".format(e)
    else:
        ok = True
        msg = "No change; skipped POST."

# GH outputs:
# A = ok
# B = msg
# ---------- end py3_2 ----------
panel = Panel(py3.B)
panel_2 = Panel(py3_2.B)
panel_3 = Panel(py3_2.A)
